# Grasshopper definition Candelabrum.ghx (Grasshopper 1.0.7)

knob = ControlKnob(Decimals=0, Limit=True, Maximum=99, Minimum=0, Range=10, Value=5)
list = ValueList({"ALPHA": "ALPHA.a.", "Beta": "Beta.0.", "Stable": " "}, selected="ALPHA")
ver = VersionCreate(P="Candelabrum", D=[list, Slider(1, range=1..9)], V=Slider(0, range=0..9), D_2=knob)
panel = Panel(ver)

number_slider = Slider(5, range=0..10)
cir = Circle(Plane=PlaneXY(0, 0, 0), Radius=number_slider)
Z = UnitZ(Factor=Slider(10, range=0..10))
move = Move(Geometry=cir, Motion=Z)  # -> Geometry, Transform
panel_2 = Panel("16")

# ---- group: A
cir_a = Curve(move.Geometry)

# ----
multiplication = Multiplication(A=number_slider, B=Slider(2.5, range=0..5))
offset = OffsetCurve(Curve=cir_a, Distance=multiplication, Corners=1)
Z_2 = UnitZ(Factor=Slider(-2, range=-5..0))
move_2 = Move(Geometry=offset, Motion=Z_2)  # -> Geometry, Transform

offset_2 = OffsetCurve(Curve=cir_a, Distance=Slider(-1.4, range=-3..3), Corners=1)
Z_3 = UnitZ(Factor=Slider(0.2, range=0..2))
move_3 = Move(Geometry=offset_2, Motion=Z_3)  # -> Geometry, Transform

# ---- group: B
cir_a_2 = Curve(move_2.Geometry)

# ---- group: 1
crv = Curve(move_3.Geometry)

# ----
series = Series(Start=0, Step=1, Count=Slider(6, range=0..7))
bnd = Bounds(Numbers=series)
remap = RemapNumbers(Value=series, Source=bnd, Target=Domain(0, 1))  # -> Mapped, Clipped
graph = GraphMapper(
    remap.Mapped,
    x0=0,
    x1=1,
    y0=0,
    y1=10,
    container_name="Bezier",
    cpx=[0, 0.807466805, 0.2748494148, 1],
    cpy=[0, 0.2821345925, 0, 1])
split = SplitList(List=graph, Index="1")  # -> ListA, ListB
offset_3 = OffsetCurve(Curve=crv, Distance=split.ListB, Corners=1)  # -> simplify(Curve)
bang = ExplodeTree(Data=offset_3)  # -> Branch0, Branch1, Branch2, Branch3, Branch4

# ---- group: 2
crv_2 = Curve(bang.Branch0)

# ---- group: 3
crv_3 = Curve(bang.Branch1)

# ---- group: 4
crv_4 = Curve(bang.Branch2)

# ---- group: 5
crv_5 = Curve(bang.Branch3)

# ---- group: 6
crv_6 = Curve(bang.Branch4)

# ---- group: B
cir_a_3 = Curve(cir_a_2)

# ---- group: 1
cir_a_4 = Curve(crv)

# ---- group: 2
crv_7 = Curve(bang.Branch0)

# ----
Z_4 = UnitZ(Factor=Slider(-0.67, range=-1..0))
divide = DivideCurve(Curve=cir_a_3, Count="16", Kinks=False)  # -> Points, Tangents, Parameters
divide_2 = DivideCurve(Curve=crv_2, Count="16", Kinks=False)  # -> Points, Tangents, Parameters
move_4 = Move(Geometry=divide.Points, Motion=Z_4)  # -> Geometry, Transform
ln = Line(StartPoint=move_4.Geometry, EndPoint=divide_2.Points)
Z_5 = UnitZ(Factor="1")
loft = Loft(Curves=ln, Options={Adjust=False, Closed=True, LoftEnds=0, LoftSimp=0, LoftType=0, Rebuild=10, Refit=0.01})
line = LineSDL(Start=move_4.Geometry, Direction=Z_5, Length=Slider(5.9, range=0..8))
pipe = Pipe(Curve=line, Radius=Slider(0.08, range=0..0.3), Caps=0)
end = EndPoints(Curve=line)  # -> Start, End
pt = Point(end.End)
Z_6 = UnitZ(Factor="-1")
Z_7 = UnitZ(Factor="-1")
Z_8 = UnitZ(Factor="-1")
pt_2 = Point(move_4.Geometry)
shift = ShiftList(List=pt_2, Shift=1, Wrap=True)
Z_9 = UnitZ(Factor=graft(["1", "-1"]))
Z_10 = UnitZ(Factor=graft(["1", "-1"]))
crv_8 = Curve(line)
Z_11 = UnitZ(Factor=graft(["1", "-1"]))
flip = FlipCurve(Curve=crv_8)  # -> Curve, Flag
shift_2 = ShiftList(List=flip.Curve, Shift=1, Wrap=True)
number_slider_2 = Slider(6, range=3..7)
number_slider_3 = Slider(6, range=3..7)
dom = ConstructDomain(DomainStart="1", DomainEnd=expr("x - 1", number_slider_2))
dom_2 = ConstructDomain(DomainStart="1", DomainEnd=expr("x -1", number_slider_3))
dom_3 = ConstructDomain(DomainStart=expr("x - 1", "1"), DomainEnd=expr("x - 2", number_slider_2))
dom_4 = ConstructDomain(DomainStart=expr("x - 1", "1"), DomainEnd=expr("x - 2", number_slider_3))
dom_5 = ConstructDomain(DomainStart=expr("x - 1", number_slider_2), DomainEnd=expr("2 * (x - 1) - 1", number_slider_2))
dom_6 = ConstructDomain(DomainStart=expr("x - 1", number_slider_3), DomainEnd=expr("2 * (x - 1) - 1", number_slider_3))
number_slider_4 = Slider(5, range=3..7)
number_slider_5 = Slider(5, range=3..7)
dom_7 = ConstructDomain(DomainStart="1", DomainEnd=expr("x - 1", number_slider_4))
dom_8 = ConstructDomain(DomainStart="1", DomainEnd=expr("x -1", number_slider_5))
Z_12 = UnitZ(Factor=expr("- x", Slider(1, range=0..4)))
Z_13 = UnitZ(Factor=expr("- x", Slider(1, range=0..4)))
dom_9 = ConstructDomain(DomainStart=expr("x - 1", "1"), DomainEnd=expr("x - 2", number_slider_4))
dom_10 = ConstructDomain(DomainStart=expr("x - 1", "1"), DomainEnd=expr("x - 2", number_slider_5))
dom_11 = ConstructDomain(DomainStart=expr("x - 1", number_slider_4), DomainEnd=expr("2 * (x - 1) - 1", number_slider_4))
dom_12 = ConstructDomain(DomainStart=expr("x - 1", number_slider_5), DomainEnd=expr("2 * (x - 1) - 1", number_slider_5))
Z_14 = UnitZ(Factor=expr("- x", Slider(1, range=0..4)))
Z_15 = UnitZ(Factor=expr("- x", Slider(0.36, range=0..4)))
material = CreateMaterial(
    Diffuse=ColourSwatch(SwatchColor=RGB(255, 254, 254)),
    Specular=RGB(255, 254, 254),
    Emission=RGB(0, 0, 0),
    Transparency=0,
    Shine=0)
brep = Brep(pipe)

number_slider_6 = Slider(16, range=1..50)
entwine = Entwine(Branch00=crv_3, Branch01=crv_4, Branch02=crv_5, Branch03=crv_6, FlattenInputs=True)

reb = RebuildCurve(Curve=entwine, Degree="1", Count=number_slider_6, Tangents=False)
reb_2 = RebuildCurve(Curve=cir_a, Degree="1", Count=number_slider_6, Tangents=False)
cp = ControlPoints(Curve=reb)  # -> Points, Weights, Knots
cullpt = CullDuplicates(Points=cp.Points, Tolerance=0.1, CullMode=3)  # -> Points, Indices, Valence

# ---- group: A
cir_a_5 = Curve(reb_2)

# ----
bang_2 = ExplodeTree(Data=simplify(cullpt.Points))  # -> Branch0, Branch1, Branch2, Branch3
bang_3 = ExplodeTree(Data=simplify(reb))  # -> Branch0, Branch1, Branch2, Branch3

# ---- group: 3
pt_3 = Point(bang_2.Branch0)
crv_9 = Curve(bang_3.Branch0)

# ---- group: 4
pt_4 = Point(bang_2.Branch1)
crv_10 = Curve(bang_3.Branch1)

# ---- group: 5
pt_5 = Point(bang_2.Branch2)
crv_11 = Curve(bang_3.Branch2)

# ---- group: 6
crv_12 = Curve(bang_3.Branch3)
pt_6 = Point(bang_2.Branch3)

# ----
ln_2 = Line(StartPoint=pt_3, EndPoint=pt_6)

offset_4 = OffsetCurve(Curve=crv_7, Distance=Slider(-0.07, range=-1..0), Corners=1)
Z_16 = UnitZ(Factor=Slider(0.1, range=0..1))
move_5 = Move(Geometry=offset_4, Motion=Z_16)  # -> Geometry, Transform
entwine_2 = Entwine(Branch00=cir_a_5, Branch01=move_5.Geometry, Branch02=crv_9, FlattenInputs=True)  # -> flatten(Result)
loft_2 = Loft(Curves=entwine_2, Options={Adjust=False, Closed=False, LoftEnds=0, LoftSimp=0, LoftType=0, Rebuild=10, Refit=0.01})

ln_3 = Line(StartPoint=pt, EndPoint=pt_6)
end_2 = EndPoints(Curve=ln_3)  # -> Start, End
offset_5 = OffsetCurve(Curve=crv_12, Distance=Slider(-9.3, range=-10..0), Corners=1)
project = ProjectPoint(Point=pt_6, Direction=Z_7, Geometry=loft)  # -> Point, Index
project_2 = ProjectPoint(Point=pt_4, Direction=Z_8, Geometry=loft)  # -> Point, Index
project_3 = ProjectPoint(Point=pt_5, Direction=Z_6, Geometry=loft)  # -> Point, Index
pt_7 = Point(project.Point)
pt_8 = Point(project_2.Point)
pt_9 = Point(project_3.Point)
ln_4 = Line(StartPoint=pt_5, EndPoint=project_3.Point)
ln_5 = Line(StartPoint=project.Point, EndPoint=end_2.End)
shift_3 = ShiftList(List=pt_7, Shift=1, Wrap=True)
ln_6 = Line(StartPoint=pt_4, EndPoint=project_2.Point)
shift_4 = ShiftList(List=pt_7, Shift="-1", Wrap=True)
crv_13 = Curve(ln_4)
crv_14 = Curve(ln_5)
ln_7 = Line(StartPoint=pt, EndPoint=shift_3)
ln_8 = Line(StartPoint=pt, EndPoint=shift_4)
crv_15 = Curve(ln_6)
pipe_2 = Pipe(Curve=[crv_15, crv_13, crv_14, ln_2], Radius=Slider(0.08, range=0..0.3), Caps=0)
pipe_3 = Pipe(Curve=[ln, ln_3], Radius=Slider(0.15, range=0..0.3), Caps=Slider(1, range=0..2))
shift_5 = ShiftList(List=crv_13, Shift=1, Wrap=True)
shift_6 = ShiftList(List=crv_13, Shift="-1", Wrap=True)
shift_7 = ShiftList(List=pt_6, Shift=1, Wrap=True)
shift_8 = ShiftList(List=crv_13, Shift=1, Wrap=True)
shift_9 = ShiftList(List=pt_3, Shift=1, Wrap=True)
shift_10 = ShiftList(List=crv_13, Shift="-1", Wrap=True)
shift_11 = ShiftList(List=pt_3, Shift="-1", Wrap=True)
crv_16 = Curve(ln_7)
end_3 = EndPoints(Curve=crv_14)  # -> Start, End
end_4 = EndPoints(Curve=shift_5)  # -> Start, End
end_5 = EndPoints(Curve=crv_14)  # -> Start, End
end_6 = EndPoints(Curve=shift_6)  # -> Start, End
end_7 = EndPoints(Curve=crv_15)  # -> Start, End
end_8 = EndPoints(Curve=crv_15)  # -> Start, End
end_9 = EndPoints(Curve=crv_15)  # -> Start, End
end_10 = EndPoints(Curve=shift_8)  # -> Start, End
end_11 = EndPoints(Curve=crv_15)  # -> Start, End
end_12 = EndPoints(Curve=shift_10)  # -> Start, End
ln_9 = Line(StartPoint=end_4.Start, EndPoint=end_5.Start)
ln_10 = Line(StartPoint=end_3.Start, EndPoint=end_6.Start)
ln_11 = Line(StartPoint=end_10.End, EndPoint=end_11.Start)
ln_12 = Line(StartPoint=shift_9, EndPoint=end_8.End)
ln_13 = Line(StartPoint=end_9.Start, EndPoint=end_12.End)
ln_14 = Line(StartPoint=shift_11, EndPoint=end_7.End)
ln_15 = Line(StartPoint=pt_6, EndPoint=shift)
ln_16 = Line(StartPoint=pt_2, EndPoint=shift_7)
crv_17 = Curve(ln_16)
llx = LineLine(Line1=crv_16, Line2=crv_17)  # -> ParamA, ParamB, PointA, PointB
pt_10 = Point(llx.PointA)
crv_18 = Curve(ln_8)
pipe_4 = Pipe(Curve=[ln_13, ln_11, ln_10, ln_9, ln_14, ln_12], Radius=Slider(0.08, range=0..0.3), Caps=0)
crv_19 = Curve(ln_15)
llx_2 = LineLine(Line1=ln_16, Line2=ln_15)  # -> ParamA, ParamB, PointA, PointB
boundary = BoundarySurfaces(Edges=flatten(offset_5))
shift_12 = ShiftList(List=crv_19, Shift="-1", Wrap=True)
llx_3 = LineLine(Line1=crv_18, Line2=shift_12)  # -> ParamA, ParamB, PointA, PointB
pt_11 = Point(llx_2.PointA)
pt_12 = Point(llx_3.PointA)
line_2 = LineSDL(Start=pt_11, Direction=Z_9, Length=1)
flip_2 = FlipMatrix(Data=line_2)
line_3 = LineSDL(Start=pt_10, Direction=Z_10, Length=Slider(0.3, range=0..1))
join = JoinCurves(Curves=flip_2, Preserve=False)  # -> flatten(Curves)
flip_3 = FlipMatrix(Data=line_3)
line_4 = LineSDL(Start=pt_12, Direction=Z_11, Length=Slider(0.3, range=0..1))
entwine_3 = Entwine(Branch00=join, Branch01=shift_2, FlattenInputs=True)
entwine_4 = Entwine(Branch00=flip.Curve, Branch01=join, FlattenInputs=True)
crv_20 = Curve(ln_5)
flip_4 = FlipMatrix(Data=entwine_3)
flip_5 = FlipMatrix(Data=line_4)
flip_6 = FlipMatrix(Data=entwine_4)
join_2 = JoinCurves(Curves=flip_3, Preserve=False)  # -> flatten(Curves)
join_3 = JoinCurves(Curves=flip_5, Preserve=False)  # -> flatten(Curves)
loft_3 = Loft(Curves=flip_6, Options={Adjust=False, Closed=False, LoftEnds=0, LoftSimp=0, LoftType=0, Rebuild=10, Refit=0.01})  # -> flatten(Loft)
flip_7 = FlipCurve(Curve=join_2)  # -> Curve, Flag
shift_13 = ShiftList(List=crv_20, Shift="-1", Wrap=True)
loft_4 = Loft(Curves=flip_4, Options={Adjust=False, Closed=False, LoftEnds=0, LoftSimp=0, LoftType=0, Rebuild=10, Refit=0.01})  # -> flatten(Loft)
flip_8 = FlipCurve(Curve=join_3)  # -> Curve, Flag
shift_14 = ShiftList(List=crv_20, Shift=1, Wrap=True)
entwine_5 = Entwine(Branch00=flip_8.Curve, Branch01=shift_13, FlattenInputs=True)
edges = BrepEdges(Brep=loft_3)  # -> Naked, Interior, NonManifold
edges_2 = BrepEdges(Brep=loft_4)  # -> Naked, Interior, NonManifold
entwine_6 = Entwine(Branch00=flip_7.Curve, Branch01=shift_14, FlattenInputs=True)
pipe_5 = Pipe(Curve=[ln_16, ln_15, crv_18, crv_19, crv_16], Radius=Slider(0.08, range=0..0.3), Caps=0)
item = ListItem(List=edges_2.Naked, Index=["0", "2"], Wrap=True)
item_2 = ListItem(List=edges.Naked, Index=["0", "2"], Wrap=True)
flip_9 = FlipMatrix(Data=entwine_5)
divide_3 = DivideCurve(Curve=item_2, Count=number_slider_2, Kinks=False)  # -> Points, Tangents, Parameters
flip_10 = FlipMatrix(Data=entwine_6)
divide_4 = DivideCurve(Curve=item, Count=number_slider_3, Kinks=False)  # -> Points, Tangents, Parameters
subset = SubList(List=divide_3.Points, Domain=dom, Wrap=True)  # -> simplify(List), Index
viewer = ParamViewer(subset.List)
subset_2 = SubList(List=divide_4.Points, Domain=dom_2, Wrap=True)  # -> simplify(List), Index
loft_5 = Loft(Curves=flip_10, Options={Adjust=False, Closed=False, LoftEnds=0, LoftSimp=0, LoftType=0, Rebuild=10, Refit=0.01})  # -> flatten(Loft)
loft_6 = Loft(Curves=flip_9, Options={Adjust=False, Closed=False, LoftEnds=0, LoftSimp=0, LoftType=0, Rebuild=10, Refit=0.01})  # -> flatten(Loft)
path_mapper = PathMapper(subset_2.List, source="{A;1}", target="{1;A}")
path_mapper_2 = PathMapper(subset_2.List, source="{A;2}", target="{2;A}")
path_mapper_3 = PathMapper(subset.List, source="{A;0}", target="{0;A}")
path_mapper_4 = PathMapper(subset.List, source="{A;1}", target="{1;A}")
pt_13 = Point(path_mapper_3)
pt_14 = Point(path_mapper_4)
edges_3 = BrepEdges(Brep=loft_5)  # -> Naked, Interior, NonManifold
viewer_2 = ParamViewer(pt_14)
viewer_3 = ParamViewer(pt_13)
edges_4 = BrepEdges(Brep=loft_6)  # -> Naked, Interior, NonManifold
subset_3 = SubList(List=pt_13, Domain=dom_3, Wrap=True)  # -> List, Index
subset_4 = SubList(List=pt_14, Domain=dom_5, Wrap=True)  # -> List, Index
subset_5 = SubList(List=path_mapper, Domain=dom_4, Wrap=True)  # -> List, Index
subset_6 = SubList(List=path_mapper_2, Domain=dom_6, Wrap=True)  # -> List, Index
item_3 = ListItem(List=edges_4.Naked, Index=["0", "2"], Wrap=True)
item_4 = ListItem(List=edges_3.Naked, Index=["0", "2"], Wrap=True)
rev = ReverseList(List=subset_4.List)
rev_2 = ReverseList(List=subset_6.List)
ln_17 = Line(StartPoint=subset_3.List, EndPoint=rev)
ln_18 = Line(StartPoint=subset_5.List, EndPoint=rev_2)
divide_5 = DivideCurve(Curve=item_4, Count=number_slider_4, Kinks=False)  # -> Points, Tangents, Parameters
divide_6 = DivideCurve(Curve=item_3, Count=number_slider_5, Kinks=False)  # -> Points, Tangents, Parameters
midpt = CurveMiddle(Curve=ln_18)
viewer_4 = ParamViewer(subset_3.List)
midpt_2 = CurveMiddle(Curve=ln_17)
viewer_5 = ParamViewer(subset_4.List)
subset_7 = SubList(List=divide_5.Points, Domain=dom_7, Wrap=True)  # -> simplify(List), Index
subset_8 = SubList(List=divide_6.Points, Domain=dom_8, Wrap=True)  # -> simplify(List), Index
move_6 = Move(Geometry=midpt, Motion=Z_12)  # -> Geometry, Transform
move_7 = Move(Geometry=midpt_2, Motion=Z_13)  # -> Geometry, Transform
scale = Scale(Geometry=ln_18, Center=move_6.Geometry, Factor=Slider(1.33, range=1..1.7))  # -> Geometry, Transform
scale_2 = Scale(Geometry=ln_17, Center=move_7.Geometry, Factor=Slider(1.33, range=1..1.7))  # -> Geometry, Transform
path_mapper_5 = PathMapper(subset_7.List, source="{A;0}", target="{0;A}")
path_mapper_6 = PathMapper(subset_7.List, source="{A;1}", target="{1;A}")
path_mapper_7 = PathMapper(subset_8.List, source="{A;1}", target="{1;A}")
path_mapper_8 = PathMapper(subset_8.List, source="{A;2}", target="{2;A}")
pt_15 = Point(path_mapper_5)
pt_16 = Point(path_mapper_6)
pipe_6 = Pipe(Curve=[scale_2.Geometry, scale.Geometry], Radius=Slider(0.06, range=0..0.3), Caps=0)
subset_9 = SubList(List=pt_15, Domain=dom_9, Wrap=True)  # -> List, Index
subset_10 = SubList(List=pt_16, Domain=dom_11, Wrap=True)  # -> List, Index
subset_11 = SubList(List=path_mapper_7, Domain=dom_10, Wrap=True)  # -> List, Index
subset_12 = SubList(List=path_mapper_8, Domain=dom_12, Wrap=True)  # -> List, Index
rev_3 = ReverseList(List=subset_10.List)
rev_4 = ReverseList(List=subset_12.List)
ln_19 = Line(StartPoint=subset_9.List, EndPoint=rev_3)
ln_20 = Line(StartPoint=subset_11.List, EndPoint=rev_4)
midpt_3 = CurveMiddle(Curve=ln_20)
midpt_4 = CurveMiddle(Curve=ln_19)
move_8 = Move(Geometry=midpt_3, Motion=Z_14)  # -> Geometry, Transform
scale_3 = Scale(Geometry=ln_20, Center=move_8.Geometry, Factor=Slider(1.33, range=1..1.7))  # -> Geometry, Transform
move_9 = Move(Geometry=midpt_4, Motion=Z_15)  # -> Geometry, Transform
scale_4 = Scale(Geometry=ln_19, Center=move_9.Geometry, Factor=Slider(1.38, range=1..1.7))  # -> Geometry, Transform
pipe_7 = Pipe(Curve=[ln_19, ln_20, scale_4.Geometry, scale_3.Geometry], Radius=Slider(0.06, range=0..0.3), Caps=0)
brep_2 = Brep(boundary)
brep_3 = Brep(brep_2)
brep_4 = Brep(pipe_5)
brep_5 = Brep(pipe_3)
brep_6 = Brep(pipe_7)
brep_7 = Brep(pipe_6)
brep_8 = Brep(loft_2)
brep_9 = Brep(pipe_4)
brep_10 = Brep(pipe_2)
geo = Geometry([brep_6, brep_7, brep_4, brep_5, brep, brep_9, brep_10, brep_8, brep_3])
preview = CustomPreview(Geometry=geo, Material=material)  # disabled

# ==== cluster VersionCreate: 自动更新
D = ClusterInput()  # type
bang = ExplodeTree(Data=graft(D))  # -> Branch0, Branch1
T = Text(bang.Branch0)
entwine = Entwine(Branch00=bang.Branch1, Branch01=".", FlattenInputs=True)  # -> flatten(Result)
tmatch = MatchText(Text=T, Pattern=" ", Case=True)
join = TextJoin(Text=entwine)
P = ClusterInput()
p_n_c = PickNChoose(Pattern=tmatch, Stream0=T, Stream1=join)
D_2 = ClusterInput()
V = ClusterInput()
P_2 = Text(P)
V_2 = Integer(V)
D_3 = Integer(D_2)
entwine_2 = Entwine(Branch00=P_2, Branch02="Ver-", Branch03=p_n_c, Branch04=V_2, Branch05=".", Branch06=D_3, FlattenInputs=True)  # -> flatten(Result)
join_2 = TextJoin(Text=entwine_2)
R = ClusterOutput(join_2)
